# Grasshopper definition 211004_Phase 1_Configuration.gh (Grasshopper 1.0.7)
# plug-ins: Kangaroo2 Components

# ---- group: User Input
# why the big courtyard in this part? that is only for the expansion fase right?
areas = Panel("""400
80
40
100""")
functions = Panel("""Theatre 
Earth Workshop
Entry Hall
Courtyard big""")

# ---- group: Configuring (X X Y) options
# STEPS: 1. Define two roads as curves (attractors|compellors)
# 2. Define an offset of two meteres
# 3. Overlay a grid over it
# 4. Get some areas options and overlay them on the grid.
number_slider = Slider(2, range=0..10.001)
ghpython_script = GhPythonScript(grid_size=number_slider, functions=functions, areas=areas)  # -> out, tree_x, tree_y, tree_pairs, ppp, aaa; inputs functions: list, areas: list
# ---------- ghpython_script: Python ----------
__author__ = "mahen"
__version__ = "2021.10.04"

import rhinoscriptsyntax as rs
import Grasshopper as gh

grid_cell_area = grid_size ** 2
#print(type(grid_cell_area))


#creating a dictionary with area per function
program = {function:area for function,area in zip(functions, areas)}

#calculate how many grid cells per function
number_cells = []
#print(areas)

#for value in areas:
#    a = (int(value) / int(grid_cell_area))
#    print(a)


for i in range(0, len(areas)):
    a = int(int(areas[i]) / int(grid_cell_area))
    print(areas[i])
    print a
    if a > 4:
        divisors = 0
        for x in range(1, a):
           #print x
            if a % x == 0:
                divisors += 1
     #make sure that there are enough XxY grid options for large areas
        if divisors <3:
                a += 1
        number_cells.append(a)
    elif a == 0:
         a = 1
         number_cells.append(a)
         print number_cells.append(a)
    else: 
        if a % 2 != 0:
            a += 1
        number_cells.append(a)
print(number_cells)

#finding "pairs" of divisors for grid options
grid_pair_opt = []
grid_x = []
grid_y = []
#print grid_x

for c in number_cells:
    print number_cells
    pair_options = []
    x_options = []
    y_options = []
#    print x_options



if c > 6:
    for a in range(1,c):
        if c % a == 0:
#            pair_options.append(int(a), int(c/a))
            x_options.append(int(a))
            y_options.append(int(c/a))
        elif c == 1:
            pair_options.append((1,1))
            x_options.append(1)
            y_options.append(2)
        else:
            for a in range(1, c+1):
                if c & a == 0:
                    pair_options.append((int(a), int(c/a)))
                    print(pair_options)
                    x_options.append(int(a))
                    y_options.append(int(c/a))
        grid_pair_opt.append(pair_options)
        grid_x.append(x_options)
#        print grid_x.append
        grid_y.append(y_options)

print(grid_pair_opt)
print(grid_x)
print(grid_y)

def listToTree(nestedList):
#Convert a nested python iterable to a datatree 
    dt = gh.DataTree[object]()
    for i,l in enumerate(nestedList):
        dt.AddRange(l,gh.Kernel.Data.GH_Path(i))
    return dt


tree_x = listToTree(grid_x)
tree_y = listToTree(grid_y)
grid_pairs = listToTree(grid_pair_opt)
# ---------- end ghpython_script ----------

# ----
ghpython_script_2 = GhPythonScript(grid_size=number_slider, functions=functions, areas=areas)  # -> out, x_size, y_size, final_pairs, ppp, aaa; inputs functions: list, areas: list
# ---------- ghpython_script_2: Python ----------
x = list(range(0,400))
y = list(range(0,400))

Area_funct = areas
values = []
Area_function = areas
_Area_function = []


for i in (list(range(15))):
    values.append(2**i)


def takeClosest(Values, Area_function):
    newlst = []
    for i in values:
        newlst.append(i - (int(Area_function))
    lstt = [abs(ele) for ele in newlst]
    _A_ = values[lstt.index(min(lstt))]
    return _A_

def x_and_yRange (x, y, _Area_function, Grid_size):
    x_coordinate = []
    y_coordinate = []
    pairs = []

    for i in x:
        for j in y:
            if (Grid_size*i)*(Grid_size*j) == _Area_function:
                x_coordinate.append(i)
                y_coordinate.append(j)
            else:
                pass
    
    for t in range(len(x_coordinate)):
        if t < ((1/2)*(len(x_coordinate))):
            pairs.append(x_coordinate[t])
            pairs.append(y_coordinate[t])
        else:
            pass


    return pairs, x_coordinate, y_coordinate

for i in Area_function:
    _Area_function.append(takeClosest(values, i))

print(_Area_function)

#
#outcome = x_and_yRange (x, y, _Area_function, Grid_size)
#
#pair_size = outcome[0]
#x_size = outcome[1]
#y_size = outcome[2]
#final_pairs = [pair_size[i:i + n] for i in range(0, len(pair_size), n)]
# ---------- end ghpython_script_2 ----------

# ----
# Why is it simplified here?
cull_pattern = CullPattern(List=simplify(ghpython_script.tree_x), CullPattern=[False, False, True, True])
cull_pattern_2 = CullPattern(List=simplify(ghpython_script.tree_y), CullPattern=[False, False, True, True])
list_length = ListLength(List=ghpython_script.tree_y)

flatten_tree = FlattenTree(Tree=ghpython_script.tree_x, Path="{0}")
flatten_tree_2 = FlattenTree(Tree=ghpython_script.tree_y, Path="{0}")
division = Division(A=flatten_tree, B=flatten_tree_2)
ghpython_script_3 = GhPythonScript(x=division)  # -> cull__pattern
# ---------- ghpython_script_3: Python ----------
__author__ = "mahen"
__version__ = "2021.10.04"

import rhinoscriptsyntax as rs

cull_pattern = []
x = []
for i in x:
    if i > 0.15 and i < 5:
        cull_pattern.append("True")
    else:
        cull_pattern.append("False")
# ---------- end ghpython_script_3 ----------
partition_list = PartitionList(List=ghpython_script_3, Size=list_length)

# ---- group: Preview Roads
number_slider_2 = Slider(2, range=1..10)
negative = Negative(Value=number_slider_2)
vehicular_road_2 = Curve(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)
vehicular_road_1 = Curve(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)
negative_2 = Negative(Value=Slider(2, range=1..10))
offset_curve = OffsetCurve(Curve=vehicular_road_1, Distance=negative_2, Corners=1)
offset_curve_2 = OffsetCurve(Curve=vehicular_road_2, Distance=number_slider_2, Corners=1)
loft = Loft(
    Curves=flatten([offset_curve_2, vehicular_road_2]),
    Options={Adjust=False, Closed=False, LoftEnds=0, LoftSimp=0, LoftType=0, Rebuild=10, Refit=0.01})
loft_2 = Loft(
    Curves=flatten([offset_curve, vehicular_road_1]),
    Options={Adjust=False, Closed=False, LoftEnds=0, LoftSimp=0, LoftType=0, Rebuild=10, Refit=0.01})
custom_preview = CustomPreview(Geometry=loft, Material=ColourSwatch(SwatchColor=RGB(232, 35, 35)))
custom_preview_2 = CustomPreview(Geometry=loft_2, Material=ColourSwatch(SwatchColor=RGB(35, 101, 232)))

# ----
# QUERIES: 1. What is the meaning of parallel computing
panel = Panel(ghpython_script.out)

flatten_tree_3 = FlattenTree(Tree=cull_pattern, Path="{0}")
flatten_tree_4 = FlattenTree(Tree=cull_pattern_2, Path="{0}")
list_length_2 = ListLength(List=cull_pattern_2)  # -> flatten(Length)
multiplication = Multiplication(A=flatten_tree_3)
multiplication_2 = Multiplication(A=flatten_tree_4)
plane_surface = PlaneSurface(Plane=PlaneXY(0, 0, 0), XSize=graft(multiplication), YSize=graft(multiplication_2))  # -> simplify(flatten(Plane))
partition_list_2 = PartitionList(List=plane_surface, Size=list_length_2)  # -> simplify(Chunks)

# ---- group: Randomly choose from surface options
bnd = Bounds(Numbers=list_length_2)
dedomain = DeconstructDomain(Domain=bnd)  # -> Start, End
dom = ConstructDomain(DomainStart=0, DomainEnd=expr("x-1", dedomain.End))
random = Random(Range=dom, Number="5", Seed="5", Integers=True)
item = ListItem(List=partition_list_2, Index=graft(random), Wrap=True)

# ----
panel_2 = Panel(division)

# ---- group: Moving grid to intersection
number_slider_3 = Slider(50, range=50..200)
curve_curve = CurveCurve(CurveA=offset_curve, CurveB=offset_curve_2)  # -> Points, ParamsA, ParamsB
square = Square(Plane=curve_curve.Points, Size=Slider(2, range=-10..2), ExtentX=number_slider_3, ExtentY=number_slider_3)  # -> Cells, Points

# ----
explode_tree = ExplodeTree(Data=item)  # -> Branch0, Branch1, Branch2, Branch3, Branch4, Branch5, Branch6, Branch7, Branch8
big_courtyard = Surface(explode_tree.Branch3)
entry_hall = Surface(explode_tree.Branch2)
surface = Surface(explode_tree.Branch4)
surface_2 = Surface(explode_tree.Branch5)
surface_3 = Surface(explode_tree.Branch6)
surface_4 = Surface(explode_tree.Branch7)
earth_workshop = Surface(explode_tree.Branch1)
surface_5 = Surface(explode_tree.Branch8)
theatre = Surface(explode_tree.Branch0)

# ---- group: Y-Axis points
flip_matrix = FlipMatrix(Data=square.Points)
list_item = ListItem(List=flip_matrix, Index=Slider(0, range=0..100), Wrap=True)
list_item_2 = ListItem(List=flatten(list_item), Index=Slider(58, range=0..100), Wrap=True)

# ---- group: X axis - points
list_item_3 = ListItem(List=square.Points, Index=Slider(0, range=0..100), Wrap=True)
list_item_4 = ListItem(List=flatten(list_item_3), Index=Slider(7, range=0..50), Wrap=True)

# ---- group: maybe unnecessary
multiplication_3 = Multiplication(A="2")
unit_y = UnitY(Factor=multiplication_3)
negative_3 = Negative(Value=unit_y)
merge = Merge(Data1=unit_y, Data2=negative_3)

# ---- group: intersection of the grid
curve_curve_2 = CurveCurve(CurveA=offset_curve, CurveB=offset_curve_2)  # -> Points, ParamsA, ParamsB
move = Move(Geometry=curve_curve_2.Points, Motion=merge)  # -> Geometry, Transform
list_item_5 = ListItem(List=move.Geometry, Index=0, Wrap=True)  # -> Item, Item1

# ---- group: Moving in Y axis
deconstruct_brep = DeconstructBrep(Brep=entry_hall)  # -> Faces, Edges, Vertices
list_item_6 = ListItem(List=deconstruct_brep.Vertices, Index=0, Wrap=True)
vector_2pt = Vector2Pt(PointA=list_item_6, PointB=list_item_2, Unitize=False)  # -> Vector, Length
move_2 = Move(Geometry=entry_hall, Motion=vector_2pt.Vector)  # -> Geometry, Transform

# ---- group: Moving the geometry
deconstruct_brep_2 = DeconstructBrep(Brep=entry_hall)  # -> Faces, Edges, Vertices
list_item_7 = ListItem(List=deconstruct_brep_2.Vertices, Index=0, Wrap=True)
vector_2pt_2 = Vector2Pt(PointA=list_item_7, PointB=list_item_4, Unitize=False)  # -> Vector, Length
move_3 = Move(Geometry=entry_hall, Motion=vector_2pt_2.Vector)  # -> Geometry, Transform

# ----
deconstruct_brep_3 = DeconstructBrep(Brep=move_2.Geometry)  # -> Faces, Edges, Vertices
deconstruct_brep_4 = DeconstructBrep(Brep=move_3.Geometry)  # -> Faces, Edges, Vertices
list_item_8 = ListItem(List=deconstruct_brep_3.Vertices, Index="2", Wrap=True)
list_item_9 = ListItem(List=deconstruct_brep_4.Vertices, Index="3", Wrap=True)

# ---- group: Moving theatre to the entry hall
rotate = Rotate(Geometry=theatre, Angle=degrees(Slider(90, range=0..100)), Plane=PlaneXY(0, 0, 0))  # -> Geometry, Transform
deconstruct_brep_5 = DeconstructBrep(Brep=rotate.Geometry)  # -> Faces, Edges, Vertices
list_item_10 = ListItem(List=deconstruct_brep_5.Vertices, Index="3", Wrap=True)
vector_2pt_3 = Vector2Pt(PointA=list_item_10, PointB=list_item_9, Unitize=False)  # -> Vector, Length
move_4 = Move(Geometry=rotate.Geometry, Motion=vector_2pt_3.Vector)  # -> Geometry, Transform

rotate_2 = Rotate(Geometry=theatre, Angle=degrees(Slider(0, range=0..100)), Plane=PlaneXY(0, 0, 0))  # -> Geometry, Transform
deconstruct_brep_6 = DeconstructBrep(Brep=rotate_2.Geometry)  # -> Faces, Edges, Vertices
list_item_11 = ListItem(List=deconstruct_brep_6.Vertices, Index="3", Wrap=True)
vector_2pt_4 = Vector2Pt(PointA=list_item_11, PointB=list_item_8, Unitize=False)  # -> Vector, Length
move_5 = Move(Geometry=rotate_2.Geometry, Motion=vector_2pt_4.Vector)  # -> Geometry, Transform

# ---- group: Moving the workshop to the theatre
deconstruct_brep_7 = DeconstructBrep(Brep=earth_workshop)  # -> Faces, Edges, Vertices
deconstruct_brep_8 = DeconstructBrep(Brep=move_4.Geometry)  # -> Faces, Edges, Vertices
list_item_12 = ListItem(List=deconstruct_brep_8.Vertices, Index="2", Wrap=True)
list_item_13 = ListItem(List=deconstruct_brep_7.Vertices, Index="0", Wrap=True)
vector_2pt_5 = Vector2Pt(PointA=list_item_13, PointB=list_item_12, Unitize=False)  # -> Vector, Length
move_6 = Move(Geometry=earth_workshop, Motion=vector_2pt_5.Vector)  # -> Geometry, Transform

# ---- group: moving the workshop to the theatre
deconstruct_brep_9 = DeconstructBrep(Brep=move_5.Geometry)  # -> Faces, Edges, Vertices
deconstruct_brep_10 = DeconstructBrep(Brep=earth_workshop)  # -> Faces, Edges, Vertices
list_item_14 = ListItem(List=deconstruct_brep_10.Vertices, Index="3", Wrap=True)
list_item_15 = ListItem(List=deconstruct_brep_9.Vertices, Index="2", Wrap=True)
vector_2pt_6 = Vector2Pt(PointA=list_item_14, PointB=list_item_15, Unitize=False)  # -> Vector, Length
move_7 = Move(Geometry=earth_workshop, Motion=vector_2pt_6.Vector)  # -> Geometry, Transform

# ----
# I dont know why this is there! Feel free to delete if it doesnt make sense
python = GhPythonScript()  # -> out, chosen_y
# ---------- python: Python ----------
chosen_y = []
if y1 < y2:
    chosen_y = [-1, -2]
else:
    chosen_y = [0, 1]
# ---------- end python ----------

# ----
# Some problem in this script in line 63!
ghpython_script_4 = GhPythonScript()  # -> out, a
# ---------- ghpython_script_4: Python ----------
__author__ = "mahen"
__version__ = "2021.10.06"

import rhinoscriptsyntax as rs

x = list(range(0,400))
y = list(range(0,400))
Grid_size = 2
Area_funct = 215
values = []
Area_function = 400

for i in (list(range(15))):
    values.append(2**i)


def takeClosest(Values, Area_function):
    newlst = []
    for i in values:
        newlst.append(i - Area_function)
    lstt = [abs(ele) for ele in newlst]
    _A_ = values[lstt.index(min(lstt))]
    return _A_

def x_and_yRange (x, y, _Area_function, Grid_size):
    x_coordinate = []
    y_coordinate = []
    pairs = []

    for i in x:
        for j in y:
            if (Grid_size*i)*(Grid_size*j) == _Area_function:
                x_coordinate.append(i)
                y_coordinate.append(j)
            else:
                pass
    
    for t in range(len(x_coordinate)):
        if t < ((1/2)*(len(x_coordinate))):
            pairs.append(x_coordinate[t])
            pairs.append(y_coordinate[t])
        else:
            pass


    return pairs, x_coordinate, y_coordinate


_Area_function = takeClosest(values, Area_function)

outcome = x_and_yRange (x, y, _Area_function, Grid_size)

pair_size = outcome[0]
x_size = outcome[1]
y_size = outcome[2]
final_pairs = [pair_size[i:i + n] for i in range(0, len(pair_size), n)]
# ---------- end ghpython_script_4 ----------

# ----
# Trying the same on kangaroo
line = Line(StartPoint=list_item_13, EndPoint=list_item_12)
line_2 = Line(StartPoint=list_item_15, EndPoint=list_item_14)
length_line = LengthLine(Line=line, Strength=10)
length_line_2 = LengthLine(Line=line_2, Strength=10)
merge_2 = Merge(Data1=length_line, Data2=length_line_2)
solver = Solver(GoalObjects=merge_2, Reset=Button(), Threshold=1e-15, Tolerance=0.0001, On=Button())  # -> I, V, O
