# Grasshopper definition split_dijkstra_final_attempt.gh (Grasshopper 1.0.7)

crv = Curve([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])

# ---- group: splitting_at_intsc
python = GhPythonScript(crvs=crv)  # -> out, a; inputs crvs: list of Curve
# ---------- python: Python ----------
from ghpythonlib.treehelpers import list_to_tree
from Rhino.Geometry.Intersect import Intersection
from scriptcontext import doc


tol = doc.ModelAbsoluteTolerance
params = []


for i in range(len(crvs)):
    params.append([])

for i in range(len(crvs)):
    for j in range(i+1, len(crvs)):
        events = Intersection.CurveCurve(crvs[i], crvs[j], tol, tol)
        for event in events:
            params[i].append(event.ParameterA)
            params[j].append(event.ParameterB)

sub_curves = []

for i in range(len(crvs)):
        sub_curves.append(crvs[i].Split(params[i]))


a = list_to_tree(sub_curves)
# ---------- end python ----------

# ---- group: streets_osm
crv_2 = Curve(flatten(python.a))

# ----
explode = Explode(Curve=crv_2, Recursive=True)  # -> Segments, Vertices
end = EndPoints(Curve=explode.Segments)  # -> Start, End
len = Length(Curve=explode.Segments)
entwine = Entwine(Branch00=end.Start, Branch01=end.End, Branch02=len, FlattenInputs=True)

# ---- group: origin_pt
pt = Point([Point(1.736723865, -67.69045279, 0), Point(48.65834044, -56.51863932, 0), Point(95.02136633, -39.20232844, 0), Point(110.6619052, 6.602106781, 0), Point(88.87686893, 16.6567389, 0), Point(66.38839733, 48.3791325, 0), Point(21.28739744, 51.84795133, 0), Point(22.40457878, 68.04708086, 0), Point(-39.59898597, 66.37130884, 0), Point(-49.65361809, 55.19949537, 0), Point(-52.44657146, 39.00036584, 0), Point(-66.96992897, -39.76091912, 0), Point(20.72880676, -0.6595719736, 0), Point(0.6195425179, -6.245478708, 0)])

# ---- group: destination
pt_2 = Point(Point(125.7438534, -20.76883622, 0))

# ---- group: summary
python_2 = GhPythonScript(crvs=[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], input=entwine, origin=pt, destination=pt_2)  # -> out, temp_point_des, temp_point_start, pointcloud, points, final_paths; inputs crvs: list of Curve, input: tree, origin: list, destination: list
# ---------- python_2: Python ----------
__author__ = "Jens (regular)"
__version__ = "2021.10.04"

import ghpythonlib.treehelpers as th
import ghpythonlib as gh
from Rhino.Geometry.Intersect import Intersection
import rhinoscriptsyntax as rs
from collections import defaultdict
from scriptcontext import doc


_x_ = th.tree_to_list(input)

points = []
endpoint = []
x_test = []
y_test = []
startpoint = []
length = []
coordinates = []
pointcloud = []
initial_ = []
initial_des = []


#sorting input attributes
for branch in _x_[0]:
    startpoint.append(rs.coerce3dpoint(branch))
for branch in _x_[1]:
    endpoint.append(rs.coerce3dpoint(branch))
for branch in _x_[2]:
    length.append(branch)

#merging same attributes to big list
for j in range(len(endpoint)):
    points.append(startpoint[j])
    points.append(endpoint[j])
    points.append(length[j])






#create sublists with startpoint, endpoint and length (as weight)
#length of sublists
n = len(_x_)
#creating subllist
sub=[] ; result=[]
for i in points:
    sub+=[i]
    if len(sub)==n: result+=[sub] ; sub=[]
if sub: result+=[sub]





#transfer data to grasshopper type
points = th.list_to_tree(result)






#find closest point on netwerk points 
__x__ = th.tree_to_list(input)
#define all points in doc:
for branch in __x__[0]:
    pointcloud.append(branch)
for branch in __x__[1]:
    pointcloud.append(branch)

#transfer from GUID to 3Dpoint
pointcloud = rs.coerce3dpointlist(pointcloud)
initial_start = rs.coerce3dpointlist(origin)
initial_destination = rs.coerce3dpointlist(destination)


#itterate for all input points
for start_pt in initial_start:
    initial_.append(rs.PointArrayClosestPoint(pointcloud, start_pt))
for destination_pt in initial_destination:
    initial_des.append(rs.PointArrayClosestPoint(pointcloud, destination_pt))




#match searched index to point in document
temp_point_start = []
temp_point_des = []
for i in initial_:
    temp_point_start.append(pointcloud[i])
for i in initial_des:
    temp_point_des.append(pointcloud[i])






#starting pathfinding
#start of pathfinding (dijkstra algorithm)
        #Created by: Ben Alex Keen
        #from:https://benalexkeen.com/implementing-djikstras-shortest-path-algorithm-with-python/
        #IMPLEMENTING DJIKSTRA'S SHORTEST PATH ALGORITHM WITH PYTHON
        #11-01-2017
        #retrieved on:03-10-2021


class Graph():
    def __init__(self):
        """
        self.edges is a dict of all possible next nodes
        e.g. {'X': ['A', 'B', 'C', 'E'], ...}
        self.weights has all the weights between two nodes,
        with the two nodes as a tuple as the key
        e.g. {('X', 'A'): 7, ('X', 'B'): 2, ...}
        """
        self.edges = defaultdict(list)
        self.weights = {}
    
    def add_edge(self, from_node, to_node, weight):
        # Note: assumes edges are bi-directional
        self.edges[from_node].append(to_node)
        self.edges[to_node].append(from_node)
        self.weights[(from_node, to_node)] = weight
        self.weights[(to_node, from_node)] = weight


graph = Graph()

edges = result


## edited by Jens Slagter
for edge in edges:
    graph.add_edge(edge[0], edge[1], edge[2])
## Somewhere in here lies the problem. It is identifying 5 arg. while it allowes for 4 and it is given 3.
## this is probably because the graph network input is not defined properly, However there is no more time left in the project to keep working on this.



##resume Ben Alex Keen algorithm
def dijsktra(graph, initial, end):
    # shortest paths is a dict of nodes
    # whose value is a tuple of (previous node, weight)
    shortest_paths = {initial: (None, 0)}
    current_node = initial
    visited = set()
    
    while current_node != end:
        visited.add(current_node)
        destinations = graph.edges[current_node]
        weight_to_current_node = shortest_paths[current_node][1]

        for next_node in destinations:
            weight = graph.weights[(current_node, next_node)] + weight_to_current_node
            if next_node not in shortest_paths:
                shortest_paths[next_node] = (current_node, weight)
            else:
                current_shortest_weight = shortest_paths[next_node][1]
                if current_shortest_weight > weight:
                    shortest_paths[next_node] = (current_node, weight)
        
        next_destinations = {node: shortest_paths[node] for node in shortest_paths if node not in visited}
        if not next_destinations:
            return 'not found'
        # next node is the destination with the lowest weight
        current_node = min(next_destinations, key=lambda k: next_destinations[k][1])

# Work back through destinations in shortest path
    path = []
    while current_node is not None:
        path.append(current_node)
        next_node = shortest_paths[current_node][0]
        current_node = next_node
    # Reverse path
    path = path[::-1]
    return path
#    shortest_path = (dijsktra(graph, startpoint, destination)) 
## end of Ben Alex Keen algorithm





## written by Jens Slagter
shortest_path = []

for i in temp_point_start:
    for j in temp_point_des:
        shortest_path.append(dijsktra(graph,i,j))

final_paths = []
for i in shortest_path:
    if i == 'not found':
        pass
    else:
        final_paths.append(i)

final_paths = th.list_to_tree(final_paths)
# ---------- end python_2 ----------

# ----
panel = Panel(python_2.temp_point_start)
panel_2 = Panel(python_2.final_paths)
pt_3 = Point(python_2.final_paths)
panel_3 = Panel(python_2.points)
pt_4 = Point(python_2.temp_point_des)
pt_5 = Point(python_2.temp_point_start)
panel_4 = Panel(python_2.pointcloud)
panel_5 = Panel(python_2.temp_point_des)
pline = PolyLine(Vertices=pt_3, Closed=False)  # -> flatten(Polyline)
explode_2 = Explode(Curve=pline, Recursive=True)  # -> Segments, Vertices
midpt = CurveMiddle(Curve=explode_2.Segments)  # -> flatten(Midpoint)
crv_3 = Curve(flatten(explode_2.Segments))
cset = CreateSet(List=midpt)  # -> Set, Map

# ---- group: count sourting amount
number_slider = Slider(7, range=0..10)

# ----
sort = SortList(Keys=cset.Map, ValuesA=crv_3)  # -> Keys, ValuesA
python_3 = GhPythonScript(x=sort.Keys, y=number_slider)  # -> out, a; inputs x: list
# ---------- python_3: Python ----------
__author__ = "Jens (regular)"
__version__ = "2021.10.05"

import ghpythonlib.treehelpers as th
import ghpythonlib as gh
from Rhino.Geometry.Intersect import Intersection
import rhinoscriptsyntax as rs
from collections import defaultdict
from scriptcontext import doc
from collections import Counter
 

b = Counter(x).most_common(y)

a = []
for i in b:
    a.append(i[0])
# ---------- end python_3 ----------
mindex = MemberIndex(Set=sort.Keys, Member=python_3.a)  # -> Index, Count
item = ListItem(List=sort.ValuesA, Index=mindex.Index, Wrap=True)  # -> reverse(Item)
item_2 = ListItem(List=item, Index=0, Wrap=True)  # -> flatten(Item)
panel_6 = Panel(item)
data = Data(reverse(item_2))
end_2 = EndPoints(Curve=data)  # -> Start, End
python_4 = GhPythonScript(x=data, S=end_2.Start, E=end_2.End)  # -> out, startpoint; inputs x: tree, E: list
# ---------- python_4: Python ----------
__author__ = "Jens (regular)"
__version__ = "2021.10.05"

import ghpythonlib.treehelpers as th
import ghpythonlib as gh
from Rhino.Geometry.Intersect import Intersection
import rhinoscriptsyntax as rs
from collections import defaultdict
from scriptcontext import doc


points = []
endpoint = []
x_test = []
y_test = []
startpoint = []

_x_ = th.tree_to_list(x)

#sorting input attributes
for branch in _x_[0]:
    startpoint.append(rs.coerce3dpoint(branch))
for branch in _x_[1]:
    endpoint.append(rs.coerce3dpoint(branch))
for branch in _x_[2]:
    length.append(branch)
# ---------- end python_4 ----------
vec2pt = Vector2Pt(PointA=end_2.Start, PointB=end_2.End, Unitize=False)  # -> Vector, Length
panel_7 = Panel(python_4.startpoint)
partition = PartitionList(List=vec2pt.Vector, Size=Slider(2, range=0..10))
panel_8 = Panel(partition)
item_3 = ListItem(List=vec2pt.Vector, Index=0, Wrap=True)
item_4 = ListItem(List=partition, Index=0, Wrap=True)
angle = Angle(VectorA=item_3, VectorB=item_4)  # -> Angle, Reflex
deg = Degrees(Radians=angle.Angle)
panel_9 = Panel(deg)
dom = ConstructDomain(DomainStart=Slider(60, range=0..100), DomainEnd=Slider(120, range=0..1000))
dispatch = Dispatch(List=deg, DispatchPattern=[True, False])  # -> ListA, ListB
